# Grasshopper definition modelisation helios.gh (Grasshopper 0.9.61)
# plug-ins: Python Interpreter, gHowl, Firefly

toggle = BooleanToggle(False)
udp = UDPReceiver(Port=6201, Pattern=0)  # -> Info, Data; disabled
udp_2 = UDPReceiver(Port=6202, Pattern=0)  # -> Info, Data; disabled
log = DataLog(IncomingData=udp.Data, ResetLog=toggle, StartRecording=True, WrapValues=False, RecordingLength=0)
log_2 = DataLog(IncomingData=udp_2.Data, ResetLog=toggle, StartRecording=True, WrapValues=False, RecordingLength=0)
panel = Panel(log)
panel_2 = Panel(log_2)
C = Separators(";")
split = TextSplit(Text=log, Separators=C)
panel_3 = Panel(split)
dispatch = Dispatch(List=split, DispatchPattern=[True, True, False])  # -> ListA, ListB
dispatch_2 = Dispatch(List=dispatch.ListA, DispatchPattern=[True, False])  # -> ListA, ListB

c_users_verseau_desktop_helios_cells_dat = FilePath("C:\Users\verseau\Desktop\helios_cells\data\positions.json")  # "C:\Users\verseau\Desktop\helios_cells\data"
json = PythonScript(FilePath=c_users_verseau_desktop_helios_cells_dat)  # -> X
# ---------- json: Python ----------
import json

if FilePath:
    
    # JSON file to read
    file = open(FilePath)
    
    # Load the data
    data = json.load(file)
    xs = [item["x"] for item in data]
    
    # Do something with the data

print xs
# ---------- end json ----------
json_2 = PythonScript(FilePath=c_users_verseau_desktop_helios_cells_dat)  # -> Y
# ---------- json_2: Python ----------
import json

if FilePath:
    
    # JSON file to read
    file = open(FilePath)
    
    # Load the data
    data = json.load(file)
    ys = [item["y"] for item in data]
    
    # Do something with the data
data2 = data[0]["y"]
print ys
# ---------- end json_2 ----------

c_users_verseau_desktop_helios_cells_dat_2 = FilePath("C:\Users\verseau\Desktop\helios_cells\data\croisementsSomme.json")  # "C:\Users\verseau\Desktop\helios_cells\data"
json_3 = PythonScript(FilePath=c_users_verseau_desktop_helios_cells_dat_2)  # -> Z
# ---------- json_3: Python ----------
import json

if FilePath:
    
    # JSON file to read
    file = open(FilePath)
    
    # Load the data
    data = json.load(file)
    Is = [item["i"] for item in data]
    
    # Do something with the data
data2 = data[0]["i"]
print Is
# ---------- end json_3 ----------
panel_4 = Panel(json_3)
panel_5 = Panel(json)
split_2 = TextSplit(Text=panel_4, Separators=",")
lng = ListLength(List=split_2)
subtraction = Subtraction(A=lng, B=2)
cull_i = CullIndex(List=split_2, Indices=lng, Wrap=True)
cull_i_2 = CullIndex(List=cull_i, Indices=subtraction, Wrap=True)

panel_6 = Panel("list of 25600 points")
_159 = Integer(159)
sqgrid = Square(Plane=PlaneXY(0, 0, 0), Size=45, ExtentX=_159, ExtentY=_159)  # -> Cells, Points
pt = Point(sqgrid.Points)

Z = UnitZ(Factor=45)
move = Move(Geometry=pt, Motion=Z)  # -> Geometry, Transform
move_2 = Move(Geometry=move.Geometry, Motion=Z)  # -> Geometry, Transform
sunion = SetUnion(SetA=pt, SetB=move.Geometry)
move_3 = Move(Geometry=move_2.Geometry, Motion=Z)  # -> Geometry, Transform
sunion_2 = SetUnion(SetA=sunion, SetB=move_2.Geometry)
sunion_3 = SetUnion(SetA=sunion_2, SetB=move_3.Geometry)

pt_2 = ConstructPoint(XCoordinate=45, YCoordinate=45, ZCoordinate=45)
pt_3 = ConstructPoint(XCoordinate=0, YCoordinate=0, ZCoordinate=0)
box = Box2Pt(PointA=pt_3, PointB=pt_2, Plane=PlaneXY(0, 0, 0))

panel_7 = Panel(json)
panel_8 = Panel(json_2)

split_3 = TextSplit(Text=panel_7, Separators=",")
split_4 = TextSplit(Text=panel_8, Separators=",")
lng_2 = ListLength(List=split_3)
lng_3 = ListLength(List=split_4)
subtraction_2 = Subtraction(A=lng_2, B=2)
subtraction_3 = Subtraction(A=lng_3, B=2)
cull_i_3 = CullIndex(List=split_3, Indices=lng_2, Wrap=True)
cull_i_4 = CullIndex(List=split_4, Indices=lng_3, Wrap=True)
cull_i_5 = CullIndex(List=cull_i_3, Indices=subtraction_2, Wrap=True)
cull_i_6 = CullIndex(List=cull_i_4, Indices=subtraction_3, Wrap=True)

panel_9 = Panel(split_3)

_45 = Number(45)
multiplication = Multiplication(A=cull_i_5, B=_45)
multiplication_2 = Multiplication(A=cull_i_6, B=_45)
panel_10 = Panel(multiplication_2)
panel_11 = Panel(multiplication)

multiplication_3 = Multiplication(A=cull_i_2, B=_45)
panel_12 = Panel(multiplication_3)

pt_4 = ConstructPoint(XCoordinate=multiplication, YCoordinate=multiplication_2, ZCoordinate=panel_12)
panel_13 = Panel(pt_4)

difference = SetDifference(SetA=sunion_3, SetB=pt_4)

move_4 = Move(Geometry=box, Motion=pt_4)  # -> Geometry, Transform
